% Simulink data dictionary CANLights.sldd

dt_SteeringWheel = Simulink.NumericType(DataTypeMode="Fixed-point: slope and bias scaling", SignednessBool=false, WordLength=8, FixedExponent=0, Bias=-128)
SteeringWheelPositionThresholdOn = Simulink.Parameter(25, DataType="int8", Unit="deg")
SteeringWheelPositionThresholdOff = Simulink.Parameter(15, DataType="int8", Unit="deg")

en_TurnSignal = enum(DefaultValue="SignalOff", StorageType="uint8")  % Enumeration of turn signal status
  SignalOff = 0  % Turn signal is off
  SignalLeft = 1  % Left turn signal is on
  SignalRight = 2  % Right turn signal is on

en_Mode = enum(DefaultValue="Off", StorageType="int8")
  Off = 0  % Lights always off
  Auto = 1  % Lights respond to steering wheel input
  On = 2  % Lights always on

ConfigSet = Simulink.ConfigSet(StartTime="0", StopTime="inf", FixedStep=".005", Solver="FixedStepDiscrete", ProdHWDeviceType="Atmel->AVR", SystemTargetFile="ert.tlc", HardwareBoard="Arduino Mega 2560", TargetLang="C")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